vi "arithmetic.gvi"   [LabVIEW NXG]
panel controls:
  "x": f64
  "x_2": f64
  "x_3": f64
  "x_4": f64
panel indicators:
  "y_2": f64
  "y_5": f64
  "y_6": f64
  "y_3": f64
  "y": f64
  "y_4": f64
diagram:
  Divide(x=$x, y=2) -> w1
  $y <- w1
  Multiply[output inverted](not -2, not $x_2) -> w2
  Subtract(x=-5, y=w2) -> w3
  Add[output inverted](w1, not w3) -> w4
  $y_2 <- w4
  $y_3 <- w4
  Add(w2, not 6) -> w5
  $y_4 <- w5
  $y_5 <- -3
  Divide(x=3, y=$x_4) -> w6
  Add(1, -2, $x_3, w6) -> w7
  $y_6 <- w7
