vi "data_type.gvi"   [LabVIEW NXG]
panel controls:
  "x": FXP(32.0)
  "x_2": i32
  "x_3": i16
  "x_4": u64
  "x_5": bool
  "x_7": bool
  "x_6": bool
  "x_8": CFXP(32.0)
  "x_9": i32[]
  "x_10": i32[]
panel indicators:
  "y_2": i32
  "y_3": i16
  "y_4": u64
  "y": FXP(1.15)
  "y_6": bool
  "y_7": bool
  "y_5": bool
  "y_8": CFXP(1.15)
  "y_9": i32[]
diagram:
  Add($x, 1) -> w1: FXP(1.15) Saturate:ConvergentRounding
  $y <- w1
  Logical Exclusive Or(FALSE, $x_6) -> w2
  $y_5 <- w2
  Subtract(x=$x_2, y=1) -> w3
  $y_2 <- w3
  Logical And[output inverted](not FALSE, $x_5) -> w4
  $y_6 <- w4
  Multiply(2, $x_3) -> w5
  $y_3 <- w5
  Logical Or(not $x_7, not TRUE) -> w6
  $y_7 <- w6
  Add(1, $x_4) -> w7: u64
  $y_4 <- w7
  Add(0+0i, $x_8) -> w8: CFXP(1.15) Saturate:ConvergentRounding
  $y_8 <- w8
  Add($x_9, $x_10) -> w9
  $y_9 <- w9
