vi "iprimitive.gvi"   [LabVIEW NXG]
panel controls:
  "x": i32
panel indicators:
  "y": i32
diagram:
  Increment(x=$x) -> w1
  Decrement(x=w1) -> w2
  Absolute Value(x=w2) -> w3
  Square(x=w3) -> w4
  $y <- w4
