vi "nestedFor_feedback.gvi"   [LabVIEW NXG]
panel controls:
  "loop_count": i32
panel indicators:
  "y_3": i32
  "y_2": i32
  "y": i32
diagram:
  w1 = $loop_count
  s1 = 0  # shift register
  for (N = w1) {
    s2 = 0  # shift register
    for (N = w1) (iteration -> i1) {
      Add(s2, i1) -> w2
      next s2 = w2
    }
    Add(s2, s1) -> w3
    Feedback Node(Input=w4) -> (Output=w5)
    Add(s2, w5) -> w4
    next s1 = w3
  }
  $y <- s2
  $y_2 <- w4
  $y_3 <- s1
