vi "simpleCase.gvi"   [LabVIEW NXG]
panel controls:
  "selector": i64
panel indicators:
  "y": i64
diagram:
  Multiply($selector, 1) -> w1
  case (w1) {
    frame 11, 12 {
      Multiply(w1, 2) -> w2
    }
    frame 1..5, Default {
      Subtract(x=w1, y=1) -> w2
    }
    frame 6..10 {
      Add(w1, 1) -> w2
    }
  }
  $y <- w2
